# Grasshopper definition Voronoi Effect1.gh (Grasshopper 1.0.8)
# plug-ins: RhinoCodePluginGH, Kangaroo2 Components

subd = SubD(<subd referenced from the Rhino model>)

# ---- group: Boundary Scaling
bbox = BoundingBox(Content=subd, Plane=PlaneXY(0, 0, 0))  # -> Box, Box_2
scaling = Slider(1.2, range=0..5)
volume = Volume(Geometry=bbox.Box)  # -> Volume, Centroid
scale = Scale(Geometry=bbox.Box, Center=volume.Centroid, Factor=scaling)  # -> Geometry, Transform

# ----
count = Slider(20, range=0..1001)
subdedges = SubDEdges(SubD=subd, NewFormatting=False)  # -> Line, Edge, Tag, Id
mindex = MemberIndex(Set=subdedges.Tag, Member="smooth, interior")  # -> Index, Count
brep = Brep(subd)
count_2 = Slider(50, range=0..1001)
item = ListItem(List=subdedges.Line, Index=mindex.Index, Wrap=True)
popgeo = PopulateGeometry(Geometry=brep, Count=count, Seed=1)
brep_2 = Brep(subd)
pop3d = Populate3D(Region=scale.Geometry, Count=count_2, Seed=1, Points=popgeo)
merge = Merge(Data1=pop3d, Data2=popgeo)

# ---- group: Point filter
brepinc = PointInBrep(Brep=brep_2, Point=merge, Strict=False)
cull = CullPattern(List=merge, CullPattern=brepinc)

# ----
voronoi³ = Voronoi3D(Points=cull)  # -> Cells, Boundary
sint = SolidIntersection(BrepsA=brep_2, BrepsB=graft(voronoi³.Cells))
py3 = Python3Script(x=brep_2, y=voronoi³.Cells)  # -> out, a; unedited script template
edges = BrepEdges(Brep=sint)  # -> Naked, flatten(Interior), NonManifold
crv = Curve(item)

# ---- group: remove formation curves
midpt = CurveMiddle(Curve=edges.Interior)
pull = PullPoint(Point=midpt, Geometry=crv, ClosestOnly=True)  # -> ClosestPoint, Distance
smaller = SmallerThan(FirstNumber=pull.Distance, SecondNumber=Slider(0.191, range=0..1))  # -> SmallerThan, OrEqualTo
cull_2 = CullPattern(List=edges.Interior, CullPattern=invert(smaller.SmallerThan))

# ----
end = EndPoints(Curve=cull_2)  # -> Start, End
ln = Line(StartPoint=end.Start, EndPoint=end.End)
dupln = RemoveDuplicateLines(Lines=ln, Tolerance=0.01)

# ---- group: weld lines
cp = ControlPoints(Curve=dupln)  # -> Points, Weights, Knots
flatten = FlattenTree(Tree=cp.Points, Path="{0}")
pgroups = PointGroups(Points=flatten, Distance=Slider(0.1, range=0..100))  # -> Groups, Indices
avr = Average(Input=pgroups.Groups)
lng = ListLength(List=pgroups.Groups)
dup = DuplicateData(Data=avr, Number=lng, Order=True)  # -> flatten(Data)
replace = ReplaceItems(List=flatten, Item=dup, Indices=flatten(pgroups.Indices), Wrap=False)
unflatten = UnflattenTree(Tree=replace, Guide=cp.Points)

# ----
pline = PolyLine(Vertices=unflatten, Closed=False)  # -> flatten(Polyline)
mp = MultiPipe(
    Curves=pline,
    NodeSize=Slider(0.2, range=0..100),
    EndOffset=1,
    StrutSize=Slider(2, range=-101.001..101),
    Segment=0,
    KinkAngle=0.6,
    CubeFit=0,
    Caps=0)
mesh = Mesh(mp)
preview = CustomPreview(
    Geometry=mesh,
    Material={diffuse=RGB(221, 160, 221), emission=RGB(66, 48, 66), shine=0.5, specular=RGB(255, 255, 255), transparency=0})
