# Grasshopper definition sandworm1.gh (Grasshopper 1.0.8)

# ---- group: Define values in specific parameters
line = Line()
# Parameters are easily spotted due
# to their black hexagonal icons. All
# parameters store values, usually
# only values of a specific type, such
# as numbers, texts, points or curves.
pt = Point()
crv = Curve()

# ---- group: Combine various values according to a formatting rule
formatting_result = Panel([pt, line, crv])

# ----
radius = Slider(9173, range=7000..110000)
count = Slider(65, range=0..101)
nurbs = NurbsCurve(Vertices=[<geometry referenced from the Rhino model> x6], Degree=Slider(5, range=0..1011), Periodic=False)  # -> Curve, Length, Domain
end = EndPoints(Curve=nurbs.Curve)  # -> Start, End
brep = Brep(<brep referenced from the Rhino model>)
vec2pt = Vector2Pt(PointA=end.Start, PointB=end.End, Unitize=False)  # -> Vector, Length
pl = PlaneNormal(Origin=end.End, ZAxis=vec2pt.Vector)
count_2 = Slider(10000, range=0..10000)
arrpolar = PolarArray(Geometry=brep, Plane=pl, Count=count, Angle=6.283185307)  # -> Geometry, Transform
unit = UnitVector(Vector=vec2pt.Vector)
number_slider = Slider(90, range=40..100)
viewer = ParamViewer()
multiplication = Multiplication(A=count_2, B=unit)
polygon = Polygon(Plane=pl, Radius=radius, Segments=count, FilletRadius=0)  # -> Polygon, Length
brep_2 = Brep(<brep referenced from the Rhino model>)
count_3 = Slider(5, range=0..101)
arrcurve = CurveArray(Geometry=brep_2, Curve=nurbs.Curve, Count=number_slider)  # -> Geometry, Transform
extr = Extrude(Base=polygon.Polygon, Direction=multiplication)
pt_2 = Point(<point referenced from the Rhino model>)
pt_3 = Point(<point referenced from the Rhino model>)
vec2pt_2 = Vector2Pt(PointA=pt_3, PointB=pt_2, Unitize=False)  # -> Vector, Length
arrpolar_2 = PolarArray(Plane=PlaneXY(0, 0, 0), Count=count_3, Angle=6.283185307)  # -> Geometry, Transform
arrlinear = LinearArray(Direction=Vector(10, 0, 0), Count=number_slider)  # -> Geometry, Transform
merge = Merge(Data1=arrlinear.Geometry, Data2=extr, Data3=arrcurve.Geometry, Data4=arrpolar.Geometry)
