# Grasshopper definition spaceship test1.gh (Grasshopper 1.0.8)
# plug-ins: Kangaroo2 Components

intcrv = Interpolate(Vertices=[<geometry referenced from the Rhino model> x14], Degree=3, Periodic=False, KnotStyle=1)  # -> Curve, Length, Domain
digit_scroller = DigitScroller(Scroller_Digits=12, Scroller_Prefix="Number", Scroller_Radix=11, Scroller_Value=54.2)
digit_scroller_2 = DigitScroller(Scroller_Digits=12, Scroller_Prefix="Number", Scroller_Radix=11, Scroller_Value=4)

# ---- group: Define values in specific parameters
line = Line()
# Parameters are easily spotted due
# to their black hexagonal icons. All
# parameters store values, usually
# only values of a specific type, such
# as numbers, texts, points or curves.
pt = Point()
crv = Curve()

# ----
num = Number(1)
viewer = ParamViewer()
brep = Brep([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])
eval = EvaluateCurve(Curve=reparameterize(<geometry referenced from the Rhino model>), Parameter=num)  # -> Point, Tangent, Angle
pt_2 = Point(<point referenced from the Rhino model>)
pt_3 = Point(<point referenced from the Rhino model>)
pt_4 = Point(<point referenced from the Rhino model>)
pt_5 = Point(<point referenced from the Rhino model>)

# ---- group: Combine various values according to a formatting rule
# Some parameters can be used to import
# (or reference) objects in the Rhino
# document.
# The 'Curve' parameter for example allows
# you to select existing curves via the
# 'Set One Curve' and 'Set Multiple Curves'
# items in the popup menu.
formatting_result = Panel([pt, line, crv])

# ----
num_2 = Number(40)
vec2pt = Vector2Pt(PointA=pt_3, PointB=pt_2, Unitize=False)  # -> Vector, Length
vec2pt_2 = Vector2Pt(PointA=pt_5, PointB=pt_4, Unitize=False)  # -> Vector, Length
round = Round(Number=digit_scroller)  # -> Nearest, Floor, Ceiling
arrcurve = CurveArray(Geometry=brep, Curve=intcrv.Curve, Count=round.Nearest)  # -> Geometry, Transform
round_2 = Round(Number=digit_scroller_2)  # -> Nearest, Floor, Ceiling
min = Minimum(A=round.Nearest, B=num_2)
brep_2 = Brep([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])
min_2 = Minimum(A=round_2.Nearest, B=num_2)
arrlinear = LinearArray(Direction=Vector(10, 0, 0), Count=min)  # -> Geometry, Transform
arrlinear_2 = LinearArray(Geometry=brep_2, Direction=vec2pt_2.Vector, Count=min_2)  # -> Geometry, Transform
merge = Merge(Data1=arrlinear.Geometry, Data2=arrlinear_2.Geometry, Data3=arrcurve.Geometry)
digit_scroller_3 = DigitScroller(Scroller_Digits=12, Scroller_Radix=9, Scroller_Value=2.682)
list = ValueList({"One": 1, "Two": 2, "Three": 2² - 1, "Four": Sqrt(16)}, selected="One")
list_2 = ValueList({"One": 1, "Two": 2, "Three": 2² - 1, "Four": Sqrt(16)}, selected="One")
list_3 = ValueList({"One": 1, "Two": 2, "Three": 2² - 1, "Four": Sqrt(16)}, selected="Four")
brep_3 = Brep(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)
viewer_2 = ParamViewer(brep_3)
context_bake = ContextBake(Content=brep_3)
crv_2 = Curve([<curve referenced from the Rhino model> x6])
curvepoint = PointOnCurve(crv_2, parameter=0)
pt_6 = Point([Point(-4.444327925, -7.637841895, 0), Point(3.927545608, -7.637841895, 0), Point(8.113482375, -0.3875867377, 0), Point(3.927545608, 6.862668419, 0), Point(-4.444327925, 6.862668419, 0)])
pt_7 = Point(Point(-8.630264692, -0.3875867377, 0))
B = Bomb(Location=pt_7, Points=pt_6, DetonationTime=list, Strength=list_2, Reset=list_3)
viewer_3 = ParamViewer(B)
points = PointList(Points=curvepoint)
